# Dynamo graph SetSpaces.dyn (Dynamo 2.0.3.8810)

categories = Categories(index=457)
all_elements_of_category = ElementsOfCategory(Category=categories)
setParameterByName = Element.SetParameterByName(element=all_elements_of_category)  # unwired: parameterName, value
code_block = CodeBlock { ["Upper Limit","Limit Offset"]; }
code_block_2 = CodeBlock { "Level"; }
getParameterValueByName = Element.GetParameterValueByName(element=all_elements_of_category, parameterName=code_block_2)
getLevelByName = archilab.Revit.Selection.Select.GetLevelByName(name=getParameterValueByName@L1)
levelAbove = Custom[Level.LevelAbove](level=getLevelByName)  # This node takes an input of level and returns level above it.
code_block_3 = CodeBlock { 1000000; }
count = List.Count(list=all_elements_of_category)
cycle = List.Cycle(list=code_block_3, amount=count)
list_create = List.Create(item0=levelAbove, item1=cycle)
combine = List.Combine(comb=setParameterByName, list1=code_block, list2=list_create)
